# Dynamo graph parking-numbering.dyn (Dynamo 3.2.1.5366)

select_model_element = DSModelElementSelection()  # 1 picked in the model
curve = CurveElement.Curve(curveElement=select_model_element)
integer_slider = IntegerSlider(400, range=0..400 step 1)
pointsAtEqualSegmentLength = Curve.PointsAtEqualSegmentLength(curve=curve, divisions=integer_slider)
splitByPoints = Curve.SplitByPoints(curve=curve, points=pointsAtEqualSegmentLength)
endPoint = Curve.EndPoint(curve=splitByPoints)
categories = Categories("OST_Parking")
all_elements_of_category = ElementsOfCategory(Category=categories)
boundingBox = Element.BoundingBox(element=all_elements_of_category)
contains = BoundingBox.Contains(boundingBox=boundingBox)  # unwired: point
map = List.Map(list=endPoint, function=contains)
filterByBoolMask = List.FilterByBoolMask(list=all_elements_of_category)  # unwired: mask
map_2 = List.Map(list=map, function=filterByBoolMask.in)
flatten = List.Flatten(list=map_2)
uniqueItems = List.UniqueItems(list=flatten)
code_block = CodeBlock { "Marca"; }
number = DoubleInput(1)
count = List.Count(list=uniqueItems)
sequence = Sequence(start=number, amount=count)
string_from_object = FromObject(object=sequence)
setParameterByName = Element.SetParameterByName(element=uniqueItems, parameterName=code_block, value=string_from_object)
