# Dynamo graph schedule-export.dyn (Dynamo 3.3.0.6316)

directory_path = Directory("C:\Exportar")
string = StringInput(";")
python_script = Python(IN[0]=directory_path, IN[1]=string)  # CPython3
# ---------- python_script.python (32 lines) ----------
# Nodo Python en Dynamo (motor CPython3 o IronPython2)
import clr
clr.AddReference('RevitAPI')
clr.AddReference('RevitServices')
from Autodesk.Revit.DB import *
from RevitServices.Persistence import DocumentManager

doc = DocumentManager.Instance.CurrentDBDocument

carpeta      = IN[0]   # ruta destino, ej: r"C:\Exportar"
delimitador  = IN[1]   # ";"  ","  o  "\t"

opts = ViewScheduleExportOptions()
opts.FieldDelimiter       = delimitador
opts.TextQualifier        = ExportTextQualifier.DoubleQuote
opts.ColumnHeaders        = ExportColumnHeaders.OneRow
opts.Title                = False   # el nombre de archivo ya identifica la tabla
opts.HeadersFootersBlanks = False   # datos limpios, sin filas de grupo/blancos

tablas = FilteredElementCollector(doc).OfClass(ViewSchedule).ToElements()

exportadas = []
for t in tablas:
    if t.IsTitleblockRevisionSchedule:   # ignora tablas de revisiones de rótulos
        continue
    nombre = t.Name
    for c in r'\/:*?"<>|':
        nombre = nombre.replace(c, "_")   # limpia caracteres inválidos
    t.Export(carpeta, nombre + ".csv", opts)
    exportadas.append(nombre)

OUT = exportadas
# ----------------------------------------
